# Dynamo graph script.dyn (Dynamo 2.12.1.8246)
# packages: Data-Shapes 2022.2.103, spring nodes 210.1.1, MEPover 2022.1.1, Genius Loci 2022.3.31, MEPover 2022.10.30

# group: Select Model Elements, Filter by Category
code_block = CodeBlock { "Click Finish when Lines are selected"; }
categories_list = Custom[Categories list]()  # package Data-Shapes; Gives list of all Revit categories and a matching list of their names
code_block_2 = CodeBlock { "Lines"; }
contains = String.Contains(string=categories_list.Category_name_s, searchFor=code_block_2)
filterByBoolMask = List.FilterByBoolMask(list=categories_list.Revit_Categories, mask=contains)
ui_selectmodelelements_data = Custom[UI.SelectModelElements Data](InputName=code_block, CategoryFilter=filterByBoolMask.in)  # package Data-Shapes; Creates a Revit element selection input for UI.MultipleInputForm++ . Check out www.data-shapes.net for more infos!

# group: Choose "DuctType"
select_ducttype = ElementTypes("DuctType")  # graph input

# group: Gather Duct Types
code_block_3 = CodeBlock { "Duct Type"; }
all_elements_of_type = ElementsOfType(element_type=select_ducttype)

name = Element.Name(element=all_elements_of_type)
code_block_4 = CodeBlock { "Rectangle"; "Oval"; "Round"; }
list_create = List.Create(item0=code_block_4.out0, item1=code_block_4.out1, item2=code_block_4.out2)
replace = String.Replace(string=name, searchFor=name, replaceWith=list_create)

# group (continued): Gather Duct Types
ui_dropdown_data = Custom[UI.DropDown Data](InputName=code_block_3, Keys=replace, Values=all_elements_of_type)  # package Data-Shapes; Create data for DropDown input in UI.MultiInputForm ++ . Check out www.data-shapes.net for more infos.

# group: Choose "MechanicalSystemType"
select_mechanicalsystemtype = ElementTypes("MechanicalSystemType")  # graph input

# group: Gather Mech Systems
code_block_5 = CodeBlock { "Duct System"; }
all_elements_of_type_2 = ElementsOfType(element_type=select_mechanicalsystemtype)
name_2 = Element.Name(element=all_elements_of_type_2)
ui_dropdown_data_2 = Custom[UI.DropDown Data](InputName=code_block_5, Keys=name_2, Values=all_elements_of_type_2)

# group: Gather Levels
code_block_6 = CodeBlock { "Level"; }
collector_of_levels = Custom[Collector of Levels]()  # package Genius Loci; Collects the levels in the active or given document and sort them by elevation.
flatten = List.Flatten(list=collector_of_levels.Name)
flatten_2 = List.Flatten(list=collector_of_levels.Element)
ui_dropdown_data_3 = Custom[UI.DropDown Data](InputName=code_block_6, Keys=flatten, Values=flatten_2)

# group: Assign Duct Sizes
code_block_7 = CodeBlock { "Width in mm"; }
code_block_8 = CodeBlock { ""; }
ui_textbox_data = Custom[UI.TextBox Data](InputName=code_block_7, DefaultText=code_block_8)  # package Data-Shapes; Create Data for TextBox input in UI.MultipleInputForm ++ . Check out www.data-shapes.net for more informations
code_block_9 = CodeBlock { "Length in mm"; }
code_block_10 = CodeBlock { ""; }
ui_textbox_data_2 = Custom[UI.TextBox Data](InputName=code_block_9, DefaultText=code_block_10)

# group: RESET
# note: (Set to False and Run to refresh the graph. Set to True when you're ready to Run again.)
RESET = BoolSelector(true)  # graph input

# group: Creates a User Interface
code_block_11 = CodeBlock { "Convert Model Lines to Revit Duct"; }
code_block_12 = CodeBlock { "Run"; }
create = List.Create(item0=ui_selectmodelelements_data, item1=ui_dropdown_data, item2=ui_dropdown_data_2, item3=ui_dropdown_data_3, item4=ui_textbox_data, item5=ui_textbox_data_2)
code_block_13 = CodeBlock { "Cancel"; }
# note: Package:  Data-Shapes
ui_multipleinputform = Custom[UI.MultipleInputForm ++](Description_optional=code_block_11, ButtonText_optional=code_block_12, Inputs=create, Toggle=RESET, CancelButtonText_optional=code_block_13)  # package Data-Shapes; Create a form with multiple inputs. see www.data-shapes.net for tutorials and infos!

# group: Sort data, format lines and diameter
code_block_14 = CodeBlock(mdlines=ui_multipleinputform.User_Inputs, ductype=ui_multipleinputform.User_Inputs, systype=ui_multipleinputform.User_Inputs, lvl=ui_multipleinputform.User_Inputs, wid=ui_multipleinputform.User_Inputs, lnth=ui_multipleinputform.User_Inputs) { mdlines[0]; ductype[1]; systype[2]; lvl[3]; wid[4]; lnth[5]; }
geometry = Element.Geometry(element=code_block_14.out0)
flatten_3 = List.Flatten(list=geometry)
toNumber = String.ToNumber(string=code_block_14.out4)
floor = Math.Floor(number=toNumber)
toNumber_2 = String.ToNumber(string=code_block_14.out5)
floor_2 = Math.Floor(number=toNumber_2)

# group: Filter out curved lines
code_block_15 = CodeBlock { "Line"; }
# note: Package:  Springs
byClassName = Custom[Springs.Filter.ByClassName](object=flatten_3, className=code_block_15)  # package spring nodes; Filters a list of objects by the object's class name. Note that Dynamo elements belong to different classes than their Revit counterparts. Use the Object.Class node to check an object's class.
filterByBoolMask_2 = List.FilterByBoolMask(list=flatten_3, mask=byClassName)

# note: Package: MEPover
byLines = Custom[DuctRectangular.ByLines](Lines=filterByBoolMask_2.in, DuctType=code_block_14.out1, MechanicalSystemType=code_block_14.out2, level=code_block_14.out3, Width=floor, Height=floor_2)  # package MEPover; Create ducts by Lines, DuctType, MechanicalFittingType, Level, Width and Height
byMEPCurves = Custom[Elbow.ByMEPCurves](MEPCurves=byLines)  # package MEPover; Takes in a list of MEPCurves (pipe, duct, cable tray, conduit) and will attempt to create elbows where possible. A margin can be entered for max distance between connectors
